# Grasshopper definition gh-ground-truth-ga.ghx (Grasshopper 1.0.7)
# plug-ins: Docofossor

# ---- group: sandbox visualization
# Dimension
list = ValueList({"real": 0, "fake": 1}, selected="fake")
sandbox_real = Brep(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)
sandbox_fake = Brep(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)
filter = StreamFilter(Gate=list, Stream0=sandbox_real, Stream1=sandbox_fake)
preview = CustomPreview(Geometry=filter, Material=ColourSwatch(SwatchColor=RGB(117, 117, 117)))

# ----
canvas = GhPythonScript()  # -> out, offset_dist, hm_bounds, c_bounds, canvas, hm_canvas
# ---------- canvas: Python ----------
# LIBRARIES
import ghpythonlib.treehelpers as th
import Rhino.Geometry as rg
import math as m

# hard corded values
fig_size = 256
tolerance = 10
hm_xbounds = [17, 1152]
hm_ybounds = [-22, -751]
hm_zbounds = [0, 130]
hm_bounds = [hm_xbounds, hm_ybounds, hm_zbounds]
hm_bounds = th.list_to_tree(hm_bounds)

# offset distance from the edge of sandbox
offset_dist = ((fig_size * m.sqrt(2)) / 2) + tolerance

# bounds for drawing area
c_xbounds = [17+offset_dist, 1152-offset_dist]
c_ybounds = [-22-offset_dist, -751+offset_dist]
c_zbounds = [0, 130]
c_bounds = [c_xbounds, c_ybounds, c_zbounds]
c_bounds = th.list_to_tree(c_bounds)

# draw canvas
xint = rg.Interval(c_xbounds[0], c_xbounds[1])
yint = rg.Interval(c_ybounds[0], c_ybounds[1])
plane = rg.Plane(rg.Point3d(0,0,130), rg.Vector3d.XAxis, rg.Vector3d.YAxis)
canvas = rg.Rectangle3d(plane, xint, yint)

xint = rg.Interval(hm_xbounds[0], hm_xbounds[1])
yint = rg.Interval(hm_ybounds[0], hm_ybounds[1])
plane = rg.Plane(rg.Point3d(0,0,130), rg.Vector3d.XAxis, rg.Vector3d.YAxis)
hm_canvas = rg.Rectangle3d(plane, xint, yint)
# ---------- end canvas ----------
hm_canvas = Geometry(canvas.hm_canvas)
canvas_2 = Geometry(canvas.canvas)

# ---- group: random
seed = Slider(31, range=1..50)
# Design
design = GhPythonScript(c_bounds=canvas.c_bounds, num_crv=Slider(20, range=1..50), seed=seed)  # -> out, c_toolpaths, gh_toolpaths; inputs c_bounds: tree of Int32, num_crv: Int32, seed: Int32
# ---------- design: Python ----------
import ghpythonlib.treehelpers as th
import compas_ghpython as cgh
import compas.geometry as cg
import random as r
import math as m


def generate_toolpaths(c_bounds, num_crv, seed):
    xbounds = c_bounds[0]
    ybounds = c_bounds[1]
    zbounds = c_bounds[2]
    lbounds = [30, 150]
    
    toolpaths = []
    for i in range(num_crv):
        x_coord = r.randint(xbounds[0], xbounds[1])
        y_coord = r.randint(ybounds[1], ybounds[0])
        z_coord = 130
        pt = cg.Point(x_coord, y_coord, z_coord)
        
        delta = r.random()
        length = r.randint(lbounds[0], lbounds[1])
        vec = cg.Vector(-length, 0, 0)
        
        T = cg.Translation.from_vector(vec)
        pt_end = pt.transformed(T)
        
        pl = cg.Polyline([pt, pt_end])
        
        # set angle
        angle = r.randint(0, 180)
        
        toolpaths.append(pl)
    return toolpaths


def draw_toolpaths(c_toolpaths):
    gh_toolpaths = []
    for tp in c_toolpaths:
        artist = cgh.artists.PolylineArtist(tp)
        pl = artist.draw()[0]
        gh_toolpaths.append(pl)
    return gh_toolpaths

c_bounds = th.tree_to_list(c_bounds)
c_toolpaths = generate_toolpaths(c_bounds, num_crv, seed)
gh_toolpaths = draw_toolpaths(c_toolpaths)
# ---------- end design ----------
crv = Curve(design.gh_toolpaths)

# ---- group: edge
distance_from_the_feature = Slider(10, range=0..10)
num_curve = Slider(10, range=0..100)
offset_distance = Slider(100, range=0..100)
offset = OffsetCurve(Curve=hm_canvas, Distance=offset_distance, Plane=PlaneXY(0, 0, 0), Corners=1)
offset_2 = OffsetCurve(Curve=hm_canvas, Distance=distance_from_the_feature, Plane=PlaneXY(0, 0, 0), Corners=1)
divide = DivideCurve(Curve=offset, Count=num_curve, Kinks=False)  # -> Points, Tangents, Parameters
divide_2 = DivideCurve(Curve=offset_2, Count=num_curve, Kinks=False)  # -> Points, Tangents, Parameters
ln = Line(StartPoint=divide_2.Points, EndPoint=divide.Points)
crv_2 = Curve(ln)

# ---- group: wave
x_count = Slider(6, range=0..30)
y_count = Slider(4, range=0..30)
boundary = BoundarySurfaces(Edges=canvas_2)
sdivide = DivideSurface(Surface=boundary, UCount=expr("x-1", x_count), VCount=expr("x-1", y_count))  # -> Points, Normals, Parameters
flip = FlipMatrix(Data=sdivide.Points)
# GA
Y = UnitY(Factor=Slider(100, range=0..100))
dispatch = Dispatch(List=flip, DispatchPattern=[True, False])  # -> ListA, ListB
neg = Negative(Value=Y)
move = Move(Geometry=dispatch.ListA, Motion=Y)  # -> Geometry, Transform
move_2 = Move(Geometry=dispatch.ListB, Motion=neg)  # -> Geometry, Transform
weave = Weave(Pattern=[0, 1], Stream0=move.Geometry, Stream1=move_2.Geometry, NullGaps=False)
nurbs = NurbsCurve(Vertices=weave, Degree=3, Periodic=False)  # -> Curve, Length, Domain
divlength = DivideLength(Curve=nurbs.Curve, Length="150")  # -> Points, Tangents, Parameters
shatter = Shatter(Curve=nurbs.Curve, Parameters=divlength.Parameters)
crv_3 = Curve(flatten(shatter))

# ----
genes = GenePool(Decimals=2, Maximum=1, Minimum=0, Value=[0.65, 0.46, 0.72, 0.64, 0.65])
x_location = Slider(0.43, range=0..1)
y_location = Slider(0.38, range=0..1)
cluster = Cluster_2(A="17", B="1152", A_2="-751", B_2="-22", A_3="0", B_3="130")
cluster_2 = Cluster_4(sb_xmin="17", V=x_location, sb_xmax="1152", sp_xmax="256", sb_ymin="-751", V_2=y_location, sb_ymax="-22", sp_ymax="256")
cluster_3 = Cluster_3(A="0", B="256", A_2="0", B_2="256", A_3="0", B_3="130")  # -> pt_2, search_space_2, I
cluster_4 = Cluster_5(G=cluster_3.search_space_2, A=cluster_3.pt_2, B=cluster_2)  # -> box_2, searchspace_corner_2
cluster_5 = Cluster(B=cluster_4.box_2, z_domain=cluster_3.I, L=genes)  # -> pt_2, L_2
sandbox = Box(cluster)
data = Data(cluster_4.searchspace_corner_2)
pt = Point(cluster_5.pt_2)
crv_4 = Curve(cluster_5.L_2)

box = Box(cluster_4.box_2)

# ---- group: proxy
initiate_proxy = Button()
start_proxy = BooleanToggle(False)
activate = BooleanToggle(False)

# ---- group: toolpath_prediction
ga_prediction = BooleanToggle(False)
searchspace_corner = Data(data)

# ---- group: save
design_iteration = Panel("5")
toggle = BooleanToggle(False)

# ---- group: scanning
scan = BooleanToggle(False)

# ----
# Prediction
proxy_control = GhPythonScript(activate=activate, start_proxy=start_proxy, initialise_proxy=initiate_proxy)  # -> out, interface; inputs activate: Boolean, start_proxy: Boolean, initialise_proxy: Boolean
# ---------- proxy_control: Python ----------
from compas_ghpython import unload_modules
from compas_ghpython import artists
unload_modules('groundtruth')
from compas.rpc import Proxy

interface = None

if activate:
    interface = Proxy('groundtruth.interactive.interface')
    if initialise_proxy:
        interface.restart_server()
    if start_proxy:
        interface.start_server()
    else:
        interface.stop_server()
# ---------- end proxy_control ----------
# Robot control
design_iteration_2 = Panel("5")
ur_controler = GhPythonScript(iteration=design_iteration_2, load_json=Toggle(False), execute=Toggle(False))  # -> out, ghframes; inputs iteration: Int32, load_json: Boolean, execute: Boolean
# ---------- ur_controler: Python ----------
from compas_ghpython.artists import FrameArtist
import ghpythonlib.treehelpers as th
import Rhino.Geometry as rg
import compas.geometry as cg
import json
import socket
import math

__GH_EXPORT__ = "G:/Shared drives/2021_MAS/T3/Common Ground Control/01_data/02_demo/01_interactive-gh/00_designs"


def remapValue(v, ori_Min, ori_Max, targetMin, targetMax):
    rv = ((v-ori_Min)/(ori_Max-ori_Min))*(targetMax-targetMin)+targetMin
    return rv

def import_json(dir, iter):
    id_num = str(iter).zfill(3)
    filepath = dir + '/{}_toolpaths.json'.format(id_num)
    print(filepath)
    with open(filepath, 'r') as f:
        data = json.load(f)
    return data

def execute_toolpath(frames):
    frames = add_safety_frames(frames, safety_dist=-200)
    script = move_robot_to_frames(frames)
    send_script("192.168.10.10",
                   30002,
                   bytes(script, 'utf-8'))

def send_script(ur_ip, UR_SERVER_PORT, script):
    """
    Function that send script to robot through socket(Ethernet cable).

    Args:
        ur_ip : local host IP. (check UR pendant)
        UR_SERVER_PORT : ur server port (check UR pendant)
        script : UR script to be sent

    Returns: NONE
    """
    s = socket.socket(socket.AF_INET, socket.SOCK_STREAM)
    s.settimeout(2)
    try:
        s.connect((ur_ip, UR_SERVER_PORT))
    except BaseException:
        print("Cannot connect to ", ur_ip, UR_SERVER_PORT)

    s.settimeout(None)
    try:
        s.send(script)
        print("Script sent to %s on port %i" % (ur_ip, UR_SERVER_PORT))
    except BaseException:
        print("failed to send")

    s.close()

def move_robot_to_frames(frames,
                         velocity=0.30,
                         acceleration=0.10,
                         radius=0.01):
    # initialize tcp
    script = ""
    script += set_tcp_by_angles(0.0,               # X
                                   0.0,               # Y
                                   305.0,  # Z
                                   math.radians(0.0),    # RX
                                   math.radians(0.0),    # RY
                                   math.radians(0.0))    # RZ
    # transform frame from compas to robot
    way_frames = [compas_to_robot_space(f) for f in frames]
    # write ur scripts
    for frame in way_frames:
        script += move_l_blend(frame,
                                  acceleration,
                                  velocity,
                                  radius)
    script = concatenate_script(script)
    return script

def concatenate_script(list_ur_commands):
    """
    Internal function that concatenates generated UR script
    into one large script file. Usually used to combine
    scripts generated by the GrasshopperPython components

    Args:
        list_ur_commands: A list of formatted UR Script strings

    Returns:
        ur_script: The concatenated script
    """

    ur_script = "\ndef my_script():\n"
    # ur_script += '\tpopup("running my_script")\n'

    combined_script = ""
    for ur_cmd in list_ur_commands:
        combined_script += ur_cmd

    # format combined script
    lines = combined_script.split("\n")
    for line in lines:
        ur_script += "\t" + line + "\n"

    ur_script += 'end\n'
    ur_script += '\nmy_script()\n'
    return ur_script


def move_l_blend(plane_to, accel, vel,
                 blend_radius=0, max_acc=1.5, max_vel=2.0):
    """
    Function that returns UR script for linear movement in tool-space.

    Args:
        plane_to: Rhino.Geometry Plane. A target plane for calculating pose.
        accel: tool accel in m/s^2
        vel: tool speed in m/s

    Returns:
        script: UR script
    """

    # Check acceleration and velocity are non-negative and below a set limit
    accel = max_acc if (abs(accel) > max_acc) else abs(accel)
    vel = max_vel if (abs(vel) > max_vel) else abs(vel)
    # Check blend radius is positive
    blend_radius = max(0, blend_radius)

    worldXY = cg.Frame.worldXY()
    _matrix = cg.Transformation.from_frame_to_frame(worldXY, plane_to)
    _axis_angle = matrix_to_axis_angle(_matrix)

    # Create pose data
    _pose = [plane_to.point[0]/1000,  # X
             plane_to.point[1]/1000,  # Y
             plane_to.point[2]/1000,  # Z
             _axis_angle[0],          # RX
             _axis_angle[1],          # RY
             _axis_angle[2]]          # RZ
    _pose_fmt = "p[" + ("%.4f,"*6)[:-1]+"]"
    _pose_fmt = _pose_fmt % tuple(_pose)
    
    # Format UR script
    script = "movel(%s, a = %.2f, v = %.2f, r = %.4f)\n" % (_pose_fmt,
                                                            accel,
                                                            vel,
                                                            blend_radius)
    return script

def matrix_to_axis_angle(m):
    """
    Function that transforms a 4x4 matrix to axis-angle format
    referenced from Martin Baker's www.euclideanspace.com

    Args:
        m: Rhino.Geometry Transform structure  - 4x4 matrix

    Returns:
        axis: Rhino.Geometry Vector3d object - axis-angle notation
    """

    epsilon = 0.01
    epsilon2 = 0.01

    if ((math.fabs(m[0, 1] - m[1, 0]) < epsilon) &
       (math.fabs(m[0, 2] - m[2, 0]) < epsilon) &
       (math.fabs(m[1, 2] - m[2, 1]) < epsilon)):
        # singularity found
        # first check for identity matrix which must have +1 for all terms
        # in leading diagonal and zero in other terms
        if ((math.fabs(m[0, 1] + m[1, 0]) < epsilon2) &
           (math.fabs(m[0, 2] + m[2, 0]) < epsilon2) &
           (math.fabs(m[1, 2] + m[2, 1]) < epsilon2) &
           (math.fabs(m[0, 0] + m[1, 1] + m[2, 2] - 3) < epsilon2)):
            # this singularity is identity matrix so angle = 0
            # make zero angle, arbitrary axis
            angle = 0
            x = 1
            y = z = 0
        else:
            # otherwise this singularity is angle = 180
            angle = math.pi
            xx = (m[0, 0] + 1) / 2
            yy = (m[1, 1] + 1) / 2
            zz = (m[2, 2] + 1) / 2
            xy = (m[0, 1] + m[1, 0]) / 4
            xz = (m[0, 2] + m[2, 0]) / 4
            yz = (m[1, 2] + m[2, 1]) / 4
            if ((xx > yy) & (xx > zz)):
                # m[0,0] is the largest diagonal term
                if (xx < epsilon):
                    x = 0
                    y = z = 0.7071
                else:
                    x = math.sqrt(xx)
                    y = xy / x
                    z = xz / x
            elif (yy > zz):
                # m[1,1] is the largest diagonal term
                if (yy < epsilon):
                    x = z = 0.7071
                    y = 0
                else:
                    y = math.sqrt(yy)
                    x = xy / y
                    z = yz / y
            else:
                # m[2,2] is the largest diagonal term so base result on this
                if (zz < epsilon):
                    x = y = 0.7071
                    z = 0
                else:
                    z = math.sqrt(zz)
                    x = xz / z
                    y = yz / z
    else:
        s = math.sqrt((m[2, 1] - m[1, 2]) * (m[2, 1] - m[1, 2]) +
                      (m[0, 2] - m[2, 0]) * (m[0, 2] - m[2, 0]) +
                      (m[1, 0] - m[0, 1]) * (m[1, 0] - m[0, 1]))
        if (math.fabs(s) < 0.001):
            # prevent divide by zero,
            # should not happen if matrix is orthogonal and should be
            s = 1
        angle = math.acos((m[0, 0] + m[1, 1] + m[2, 2] - 1) / 2)
        x = (m[2, 1] - m[1, 2]) / s
        y = (m[0, 2] - m[2, 0]) / s
        z = (m[1, 0] - m[0, 1]) / s
    angleRad = angle
    axis = cg.Vector(x, y, z)
    axis = axis*angleRad

    return axis


def compas_to_robot_space(geo):
    compas_origin_frame = cg.Frame.worldXY()
    robot_frame = get_robot_frame()
    M = cg.Transformation.from_frame_to_frame(compas_origin_frame,
                                              robot_frame)

    R = cg.Rotation.from_axis_and_angle(cg.Vector.Zaxis(), math.radians(180.))

    T = R.concatenated(M)

    geo_trans = geo.transformed(T)

    return geo_trans

def get_robot_frame():
    pt_o, pt_x, pt_y = get_robot_corner_pts()
    robot_frame = cg.Frame(pt_o, pt_x-pt_o, pt_y-pt_o)
    return robot_frame


def get_robot_corner_pts():
    pt_o = cg.Point(-338,
                    587,
                    -460)
    pt_x = cg.Point(-338,
                    -577,
                    -460)
    pt_y = cg.Point(-1101,
                    587,
                    -460)
    return pt_o, pt_x, pt_y


def set_tcp_by_angles(x_offset, y_offset, z_offset,
                      x_rotate, y_rotate, z_rotate):
    """
    Function that returns UR script for setting tool center point

    Args:
        x_offset: float. tooltip offset in mm
        y_offset: float. tooltip offset in mm
        z_offset: float. tooltip offset in mm
        x_rotation: float. rotation around world x axis in radians
        y_rotation: float. rotation around world y axis in radians
        z_rotation: float. rotation around world z axis in radians

    Returns:
        script: UR script
    """

    # Create rotation matrix
    RX = cg.Rotation.from_axis_and_angle(cg.Vector.Xaxis(), x_rotate)
    RY = cg.Rotation.from_axis_and_angle(cg.Vector.Yaxis(), y_rotate)
    RZ = cg.Rotation.from_axis_and_angle(cg.Vector.Zaxis(), z_rotate)
    R = RZ * RY * RX

    # _axis_angle= R.euler_angles()
    _axis_angle = matrix_to_axis_angle(R)

    # Create pose data
    _pose = [x_offset/1000, y_offset/1000, z_offset/1000,
             _axis_angle[0], _axis_angle[1], _axis_angle[2]]
    _pose_fmt = "p[" + ("%.4f,"*6)[:-1]+"]"
    _pose_fmt = _pose_fmt % tuple(_pose)

    # Format UR script
    script = "set_tcp(%s)\n" % (_pose_fmt)

    return script

def add_safety_frames(frames, safety_dist=200):
    frame_s = frames[0].copy()
    frame_e = frames[-1].copy()
    frame_s.point.z += safety_dist
    frame_e.point.z += safety_dist
    frames.insert(0, frame_s)
    frames.append(frame_e)
    return frames


frames_tree = []
ghframes = []

if load_json:
    id_num = str(iteration).zfill(3)
    filepath = __GH_EXPORT__ + '/{}_toolpaths.json'.format(id_num)
    print(filepath)
    with open(filepath, 'r') as f:
        data = json.load(f)
    if data == None:
        print('data is None')
        
    else:
        tp_keys = data.keys()
        tp_keys.sort()
        for tpk in tp_keys:
            frames_list = []
            f_keys = data[tpk].keys()
            f_keys.sort()
            for fk in f_keys:
                frame = cg.Frame.from_jsonstring( data[tpk][fk] )
                frames_list.append(frame)
            frames_list_safe = add_safety_frames(frames_list, safety_dist=-130)
            frames_tree.append(frames_list_safe)
    
    flat_list = []
    for frames_list in frames_tree:
        for f in frames_list:
            flat_list.append(f)
            # visualise
            fake = f.copy()
            fake.point.z = remapValue(f.point.z, 130, 0, 0, 130)
            fake.point.y *= (-1)
            artist = FrameArtist(fake)
            gh_frame = artist.draw()
            ghframes.append(gh_frame)

if execute:
    sliced = flat_list[3000::]
    execute_toolpath(sliced)
# ---------- end ur_controler ----------
panel = Panel(ur_controler.out)
pline = PolyLine(Vertices=ur_controler.ghframes, Closed=False)

# ---- group: grid
x_count_2 = Slider(10, range=0..30)
y_count_2 = Slider(10, range=0..30)
length = Slider(75, range=0..150)
angle = Slider(45, range=0..360)

boundary_2 = BoundarySurfaces(Edges=canvas_2)
sdivide_2 = DivideSurface(Surface=boundary_2, UCount=expr("x-1", x_count_2), VCount=expr("x-1", y_count_2))  # -> Points, Normals, Parameters
flatten = FlattenTree(Tree=sdivide_2.Points, Path="{0}")

division = Division(A=length, B=2)
X = UnitX(Factor=1)
neg_2 = Negative(Value=X)
line = LineSDL(Start=flatten, Direction=X, Length=division)
line_2 = LineSDL(Start=flatten, Direction=neg_2, Length=division)
join = JoinCurves(Curves=[line, line_2], Preserve=False)

rad = Radians(Degrees=angle)
xy = XYPlane(Origin=flatten)
rotate = Rotate(Geometry=join, Angle=rad, Plane=xy)  # -> Geometry, Transform

crv_5 = Curve(rotate.Geometry)

# ---- group: length chech / translator
list_2 = ValueList({"random": 0, "grid": 1, "edge": 2, "GA": 3}, selected="GA")
filter_2 = StreamFilter(Gate=list_2, Stream0=crv, Stream1=crv_5, Stream2=crv_2, Stream3=crv_4)
translatot = GhPythonScript(gh_crv=filter_2)  # -> compas_crvs, ghs; inputs gh_crv: list of Curve
# ---------- translatot: Python ----------
from compas_ghpython.artists import PolylineArtist
import compas.geometry as cg
import Rhino.Geometry as rg

rg.Polyline.PointAt

seg = 100
step = 1 / (100-1)
interval = rg.Interval(0, 1)


pls = []
for c in gh_crv:
    c.Domain = interval
    
    pts = []
    for i in range(seg):
        param = i * step
        p = c.PointAt(param)
        pts.append(p)
    pl = cg.Polyline(pts)
    pls.append(pl)
compas_crvs = pls


# visualize
ghs = []
for pl in pls:
    art = PolylineArtist(pl)
    gh = art.draw()
    ghs.append(gh[0])
# ---------- end translatot ----------

# ---- group: sand prediction
prediction = BooleanToggle(False)
adaptive = BooleanToggle(False)
compas_toolpaths = Data(translatot.compas_crvs)

# ----
ground_truth = GhPythonScript(
    interface=proxy_control.interface,
    scan_sandbox=scan,
    toolpaths=compas_toolpaths,
    prediction=prediction,
    adaptive=adaptive,
    ga_prediction=ga_prediction,
    searchspace_corner=searchspace_corner)  # -> out, f_scan, f_pred, tp, fitness; inputs scan_sandbox: Boolean, toolpaths: list, prediction: Boolean, adaptive: Boolean, searchspace_corner: list
# ---------- ground_truth: Python ----------
#from compas_ghpython import unload_modules
#from compas_ghpython import artists
#unload_modules('groundtruth')
#from compas.rpc import Proxy
#
#interface = None
#
#if activate:
#    interface = Proxy('groundtruth.interactive.interface')
#    if initialise_proxy:
#        interface.restart_server()
#    if start_proxy:
#        interface.start_server()
#    else:
#        interface.stop_server()
        
        
if interface:
    if scan_sandbox:
        f_scan = interface.scan_sandbox()
    if prediction:
        f_pred, tp = interface.prediction(toolpaths, adaptive)
    if ga_prediction:
        fitness = interface.prediction_gh(toolpaths, searchspace_corner)
# ---------- end ground_truth ----------
messages = Panel(ground_truth.out)

# ---- group: height map visualization
list_3 = ValueList({"scan": 0, "prediction": 1, "test scan": 2}, selected="scan")
dam = DataDam(DataF=ground_truth.f_scan, BufferDelay=10000000, BufferMode=0)
dam_2 = DataDam(DataF=ground_truth.f_pred, BufferDelay=10000000, BufferMode=0)
txt = Text("G:\Shared drives\2021_MAS\T3\Common Ground Control\01_data\02_demo\01_interactive-gh\01_data/scan_grid.asc")
filter_3 = StreamFilter(Gate=list_3, Stream0=dam, Stream1=dam_2, Stream2=txt)
dfimportasc = ImportASC(F=filter_3, N="10")
dfgridmesh = GridMesh(Df=dfimportasc)
coloring_mesh = ColoringMesh(mesh=dfgridmesh)
mesh = Mesh(coloring_mesh)

# ---- group: toolpath prediction
galapagos = Galapagos(fitness=fitness, gene=genes)
fitness = Number(ground_truth.fitness)

# ---- group: toolpaths visualization
list_4 = ValueList({"points": 0, "frames": 1, "polyline": 2}, selected="polyline")
dam_3 = DataDam(DataTp=ground_truth.tp, BufferDelay=10000000, BufferMode=0)
tp_visualise = GhPythonScript(tp=dam_3, vis_type=list_4, iteration=design_iteration, export=toggle)  # -> vis; inputs tp: list, iteration: Int32, export: Boolean
# ---------- tp_visualise: Python ----------
import ghpythonlib.treehelpers as th
import Rhino.Geometry as rg
import compas.geometry as cg
from compas_ghpython.artists import PointArtist, FrameArtist, PolylineArtist
import json

__GH_EXPORT__ = "G:/Shared drives/2021_MAS/T3/Common Ground Control/01_data/02_demo/01_interactive-gh/00_designs"

def export_json(dir, data, iter):
    id_num = str(iter).zfill(3)
    filepath = dir + '/{}_toolpaths.json'.format(id_num)
    with open(filepath, 'w') as o:
        json.dump(data, o, indent=4)


def export_design(tp, iteration):
    # initiate data
    data = {}
    # store control frames
    for i, f_list in enumerate(tp):
        toolpath_num = str(i).zfill(3)
        toolpath_key = 'toolpath_{}'.format(toolpath_num)
        data[toolpath_key] = {}
        for j, f in enumerate(f_list):
            frame_num = str(j).zfill(3)
            frame_key = 'f_{}'.format(frame_num)
            # mirror
            f_mirror = f.copy()
            f_mirror.point.y *= (-1)
            data[toolpath_key][frame_key] = f_mirror.to_jsonstring()
    # export json
    export_json(dir=__GH_EXPORT__, data=data, iter=iteration)


def remapValue(v, ori_Min, ori_Max, targetMin, targetMax):
    rv = ((v-ori_Min)/(ori_Max-ori_Min))*(targetMax-targetMin)+targetMin
    return rv

if tp[0] != None:
    frames_tree = []
    pts_tree = []
    pls_list = []
    compas_tree = []
    for t in tp:
        frames_list = []
        compas_list = []
        pts_list = []
        for f in t:
            f_mirror = f.copy()
            f_mirror.point.y *= (-1)
            # move frame
            framefrom = cg.Frame(cg.Point(0, 0, 0),
                                 cg.Vector.Xaxis(),
                                 cg.Vector.Yaxis())
            frameto = cg.Frame(cg.Point(17,
                                        -22,
                                        0),
                               cg.Vector.Xaxis(),
                               cg.Vector.Yaxis())
            T = cg.Transformation.from_frame_to_frame(framefrom, frameto)
            f_moved = f_mirror.transformed(T)
            f_compas = f_moved.copy()
            # remap z_values
            f_moved.point.z = remapValue(f_moved.point.z, 0, 130, 130, 0)
            # call artist
            compas_list.append(f_compas)
            artist = FrameArtist(f_moved)
            plane = artist.draw()
            frames_list.append(plane)
            pts_list.append(plane.Origin)
        compas_tree.append(compas_list)
        # frames
        frames_tree.append(frames_list)
        # pts
        pts_tree.append(pts_list)
        # polyline
        pl = rg.Polyline(pts_list)
        pls_list.append(pl)
    
    if vis_type == 0:
        vis = pts_tree
        vis = th.list_to_tree(vis)
    elif vis_type == 1:
        vis = frames_tree
        vis = th.list_to_tree(vis)
    elif vis_type == 2:
        vis = pls_list



if export:
    export_design(compas_tree, iteration)
# ---------- end tp_visualise ----------
geo = Geometry(tp_visualise)
preview_2 = CustomPreview(Geometry=geo, Material=ColourSwatch(SwatchColor=RGB(0, 64, 255)))

# ==== cluster ColoringMesh
mesh = ClusterInput()
mesh_2 = Mesh(mesh)
demesh = DeconstructMesh(Mesh=mesh_2)  # -> Vertices, Faces, Colours, Normals
pdecon = Deconstruct(Point=demesh.Vertices)  # -> XComponent, YComponent, ZComponent
remap = RemapNumbers(Value=pdecon.ZComponent, Source="0.0 To 150.0", Target=Domain(0, 1))  # -> Mapped, Clipped
frgb = ColourRGBF(Alpha=1, Red=remap.Mapped, Green=remap.Mapped, Blue=remap.Mapped)
mcol = MeshColours(Mesh=mesh_2, Colours=frgb)
M = ClusterOutput(mcol)

# ==== cluster Cluster
L = ClusterInput()
B = ClusterInput()
z_domain = ClusterInput()
item = ListItem(List=L, Index=0, Wrap=True)  # -> Item, Item1, Item2, Item3, Item4
debox = DeconstructBox(Box=B)  # -> Plane, X, Y, Z
deplane = DeconstructPlane(Plane=debox.Plane)  # -> Origin, XAxis, YAxis, ZAxis
pdecon = Deconstruct(Point=deplane.Origin)  # -> XComponent, YComponent, ZComponent
dedomain = DeconstructDomain(Domain=debox.X)  # -> Start, End
dedomain_2 = DeconstructDomain(Domain=debox.Y)  # -> Start, End
addition = Addition(A=pdecon.XComponent, B=dedomain.Start)
addition_2 = Addition(A=pdecon.XComponent, B=dedomain.End)
addition_3 = Addition(A=pdecon.YComponent, B=dedomain_2.Start)
addition_4 = Addition(A=pdecon.YComponent, B=dedomain_2.End)
dom = ConstructDomain(DomainStart=addition, DomainEnd=addition_2)
dom_2 = ConstructDomain(DomainStart=addition_3, DomainEnd=addition_4)
y_domain = Domain(dom_2)
z_domain_2 = Domain(z_domain)
a_domain = Domain(Domain(0, 360))
x_domain = Domain(dom)
l_domain = Domain(Domain(0, 150))
remap = RemapNumbers(Value=item.Item, Source=Domain(0, 1), Target=x_domain)  # -> Mapped, Clipped
remap_2 = RemapNumbers(Value=item.Item1, Source=Domain(0, 1), Target=y_domain)  # -> Mapped, Clipped
remap_3 = RemapNumbers(Value=item.Item2, Source=Domain(0, 1), Target=z_domain_2)  # -> Mapped, Clipped
angle = RemapNumbers(Value=item.Item3, Source=Domain(0, 1), Target=a_domain)  # -> Mapped, Clipped
length = RemapNumbers(Value=item.Item4, Source=Domain(0, 1), Target=l_domain)  # -> Mapped, Clipped
pt = ConstructPoint(XCoordinate=remap.Mapped, YCoordinate=remap_2.Mapped, ZCoordinate=remap_3.Mapped)
pt_2 = ClusterOutput(pt)
X = UnitX(Factor=1)
Z = UnitZ(Factor=1)
vrot = Rotate(Vector=X, Axis=Z, Angle=degrees(angle.Mapped))
line = LineSDL(Start=pt, Direction=vrot, Length=length.Mapped)
L_2 = ClusterOutput(line)

# ==== cluster Cluster_2
A = ClusterInput()
B = ClusterInput()
A_2 = ClusterInput()
B_2 = ClusterInput()
A_3 = ClusterInput()
B_3 = ClusterInput()
dom = ConstructDomain(DomainStart=A, DomainEnd=B)
dom_2 = ConstructDomain(DomainStart=A_2, DomainEnd=B_2)
dom_3 = ConstructDomain(DomainStart=A_3, DomainEnd=B_3)
y_domain = Domain(dom_2)
x_domain = Domain(dom)
z_domain = Domain(dom_3)
box = DomainBox(Base=PlaneXY(0, 0, 0), X=x_domain, Y=y_domain, Z=z_domain)
B_4 = ClusterOutput(box)

# ==== cluster Cluster_3
A = ClusterInput()
B = ClusterInput()
A_2 = ClusterInput()
B_2 = ClusterInput()
A_3 = ClusterInput()
B_3 = ClusterInput()

# ---- group: original search space
dom = ConstructDomain(DomainStart=A, DomainEnd=B)
dom_2 = ConstructDomain(DomainStart=A_2, DomainEnd=B_2)
dom_3 = ConstructDomain(DomainStart=A_3, DomainEnd=B_3)
y_domain = Domain(dom_2)
x_domain = Domain(dom)
z_domain = Domain(dom_3)
box = DomainBox(Base=PlaneXY(0, 0, 0), X=x_domain, Y=y_domain, Z=z_domain)
rectangle = Rectangle(Plane=PlaneXY(0, 0, 0), XSize=x_domain, YSize=y_domain, Radius=0)  # -> Rectangle, Length
area = Area(Geometry=rectangle.Rectangle)  # -> Area, Centroid
search_space = Box(box)
pt = Point(area.Centroid)

# ----
I = ClusterOutput(dom_3)
search_space_2 = ClusterOutput(search_space)
pt_2 = ClusterOutput(pt)

# ==== cluster Cluster_4
sp_xmax = ClusterInput()
sb_xmin = ClusterInput()
sb_xmax = ClusterInput()
sp_ymax = ClusterInput()
sb_ymin = ClusterInput()
sb_ymax = ClusterInput()
V = ClusterInput()
V_2 = ClusterInput()

# ---- group: search space location
sp_xmax_2 = Number(sp_xmax)
sp_ymax_2 = Number(sp_ymax)
division = Division(A=sp_ymax_2, B="2")
division_2 = Division(A=sp_xmax_2, B="2")
sb_ymin_2 = Number(sb_ymin)
sb_ymax_2 = Number(sb_ymax)
sb_xmin_2 = Number(sb_xmin)
sb_xmax_2 = Number(sb_xmax)
subtraction = Subtraction(A=sb_ymax_2, B=division)
subtraction_2 = Subtraction(A=sb_xmax_2, B=division_2)
addition = Addition(A=sb_ymin_2, B=division)
addition_2 = Addition(A=sb_xmin_2, B=division_2)
dom = ConstructDomain(DomainStart=addition, DomainEnd=subtraction)
dom_2 = ConstructDomain(DomainStart=addition_2, DomainEnd=subtraction_2)
x_domain = Domain(dom_2)
y_domain = Domain(dom)
remap = RemapNumbers(Value=V, Source=Domain(0, 1), Target=x_domain)  # -> Mapped, Clipped
remap_2 = RemapNumbers(Value=V_2, Source=Domain(0, 1), Target=y_domain)  # -> Mapped, Clipped
pt = ConstructPoint(XCoordinate=remap.Mapped, YCoordinate=remap_2.Mapped, ZCoordinate="0")
pt_2 = Point(pt)

# ----
pt_3 = ClusterOutput(pt_2)

# ==== cluster Cluster_5
G = ClusterInput()
A = ClusterInput()
B = ClusterInput()

# ---- group: moved search space
vec2pt = Vector2Pt(PointA=A, PointB=B, Unitize=False)  # -> Vector, Length
move = Move(Geometry=G, Motion=vec2pt.Vector)  # -> Geometry, Transform
box = Box(move.Geometry)

# ----
box_2 = ClusterOutput(box)

# ---- group: get search space corner points
debrep = DeconstructBrep(Brep=box)  # -> Faces, Edges, Vertices
crv = Curve(debrep.Edges)
item = ListItem(List=debrep.Vertices, Index=[0, 1, 2, 3], Wrap=True)
rev = ReverseList(List=item)
python = GhPythonScript(pts=rev)  # -> out, c_pts; inputs pts: list of Point3d
# ---------- python: Python ----------
import compas.geometry as cg

c_pts = []
for p in pts:
    pt = cg.Point(p.X, p.Y, p.Z)
    c_pts.append(pt)
# ---------- end python ----------
searchspace_corner = Data(python.c_pts)

# ----
searchspace_corner_2 = ClusterOutput(searchspace_corner)
