# Grasshopper definition proxy_test.ghx (Grasshopper 1.0.7)

python = GhPythonScript(activate=Toggle(False), start_proxy=Toggle(False))  # -> out, a; inputs activate: Boolean, start_proxy: Boolean
# ---------- python: Python ----------
from compas_ghpython import unload_modules
unload_modules('toolbox')
from compas.rpc import Proxy


if activate:
    if start_proxy:
        toolbox = Proxy('toolbox')
    else:
        Proxy.stop_server(toolbox)
# ---------- end python ----------
